# Grasshopper definition 230_KUKAprc_E.ghx (Grasshopper 1.0.7)
# plug-ins: KUKA|prc - parametric robot control, Fologram For Grasshopper Utilities, raccoon

toggle = BooleanToggle(False)
# Raccoon KUKA Robot Cell Template
# v0.3.1
number_slider = Slider(6, range=0..10)
socket = KVPSocketConnection(Connect=toggle, IPAddress="192.168.1.201", Port=7000)  # -> SocketClient, Messages

# ---- group: Gripper
gripper_mesh = Mesh(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)
custom_tool = CustomToolKUKAPrc(
    CustomToolGeometry=gripper_mesh,
    toolid=4,
    toolvala=0,
    toolvalb=-90,
    toolvalc=0,
    toolvalx=0,
    toolvaly=0,
    toolvalz=360,
    valuesset=True)

# ---- group: Spindle
spindle_mesh = Mesh(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)
custom_tool_2 = CustomToolKUKAPrc(
    CustomToolGeometry=spindle_mesh,
    toolid=6,
    toolvala=-90,
    toolvalb=0,
    toolvalc=0,
    toolvalx=2.702,
    toolvaly=-412.093,
    toolvalz=261.09,
    valuesset=True)

# ----
pt = Point(Point(747.388916, -812.7003174, 1207.832031))

# ---- group: 原點
pt_2 = Point(pt)

# ----
tool = GetToolData(Update=toggle, IPAddress="192.168.1.201", Account=number_slider, ToolID=1)

# ---- group: Flange
# Tool Description
custom_tool_3 = CustomToolKUKAPrc(toolid=3, toolvala=0, toolvalb=0, toolvalc=0, toolvalx=0, toolvaly=0, toolvalz=0, valuesset=True)

# ----
cluster = Cluster_4(B=pt_2, B_2=pt_2)  # -> B_3, P, P_2

axis_move = AXISMovementKUKAPrc(
    Axis1=Slider(-90, range=-180..180),
    Axis2=Slider(-100, range=-180..180),
    Axis3=Slider(120, range=-180..180),
    Axis4=Slider(0, range=-180..180),
    Axis5=Slider(-20, range=-180..180),
    Axis6=Slider(-90, range=-180..180),
    ExternalAxis1="750",
    extaxenabled=True,
    interpolation="C_PTP")

# ----
# Robot Description
cluster_2 = Cluster()  # -> robot, robot_2

# ----
# Env. Description
world_collision = Mesh(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)
world_visual = Mesh([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])

tcp = GetTCP(Socket=socket.SocketClient, Update=Button(), RefreshRate=50)  # -> AxisValues, TCPPlane, XYZ, ABC
preview = CustomPreview(Geometry=cluster.P_2, Material=ColourSwatch(SwatchColor=RGB(0, 0, 0)))
preview_2 = CustomPreview(Geometry=cluster.P, Material=ColourSwatch(SwatchColor=RGB(0, 255, 255)))
panel = Panel(tool)

# ---- group: 模擬動作路徑
number_slider_2 = Slider(0.671, range=0..1)

# ---- group: 選擇曲線造型
number_slider_3 = Slider(3, range=1..3)

# ---- group: 存檔
button = Button()

# ---- group: 檔名
panel_2 = Panel("TEST01_E")

# ---- group: 選擇運動模式
list = ValueList({"PTP": 0, "LIN": 1}, selected="PTP")

# ----
T = StateGate(States=number_slider_3)  # -> _0, _1, _2, _3
crv = Curve(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)

# ---- group: 隨機曲線
# 1
number_slider_4 = Slider(180, range=50..180)  # disabled
number_slider_5 = Slider(7, range=3..15)  # disabled
number_slider_6 = Slider(156, range=0..200)  # disabled
cluster_3 = Cluster_2(B_2=pt_2, A=number_slider_4, B=number_slider_4, N=number_slider_5, S=number_slider_6)  # disabled

# ---- group: 螺旋線
# 2
旋轉幅度 = Slider(5.28, range=1..8)  # disabled
圈數 = Slider(22, range=0..50)  # disabled
高度 = Slider(-20, range=-20..20)  # disabled
半徑 = Slider(215, range=0..350)  # disabled
cluster_4 = Cluster_3(P=pt_2, R=半徑, C=pt_2, N=圈數, N_2=圈數, B=旋轉幅度, N_3=高度, C_2=圈數, B_2=pt_2)  # disabled

# ---- group: 自定義曲線
# 3
crv_2 = Curve(crv)
cluster_5 = Cluster_5(G=crv_2, C=crv_2, B=pt_2)

# ----
filter = StreamFilter(Gate=number_slider_3, Stream1=cluster_3, Stream2=cluster_4, Stream3=cluster_5)

# ---- group: 重新計算
dam = DataDam(DataA=filter, BufferDelay=10000000, BufferMode=0)

# ----
topoly = CurveToPolyline(Curve=dam, ToleranceDistance="0.6", ToleranceAngle=0)  # -> Polyline, Segments
cp = ControlPoints(Curve=topoly.Polyline)  # -> flatten(Points), Weights, Knots
brepinc = PointInBrep(Brep=cluster.B_3, Point=cp.Points, Strict=False)
not = GateNot(A=brepinc)
int = Integer(not)
ma = MassAddition(Input=int)  # -> Result, PartialResults
larger = LargerThan(FirstNumber=ma.Result, SecondNumber="0")  # -> LargerThan, OrEqualTo
filter_2 = StreamFilter(
    Gate=larger.LargerThan,
    Stream0=ColourSwatch(SwatchColor=RGB(4, 255, 0)),
    Stream1=ColourSwatch(SwatchColor=RGB(255, 0, 0)))
preview_3 = CustomPreview(Geometry=filter, Material=filter_2)
filter_3 = StreamFilter(Gate=larger.LargerThan, Stream0=cp.Points)
xy = XYPlane(Origin=filter_3)
number_slider_7 = Slider(30, range=-180..180)  # disabled
prot = RotatePlane(Plane=xy, Angle=degrees("95"))
deplane = DeconstructPlane(Plane=prot)  # -> Origin, XAxis, YAxis, ZAxis; disabled
line = LineSDL(Start=deplane.Origin, Direction=deplane.YAxis, Length=1)  # disabled
rot3d = Rotate3D(Geometry=prot, Angle=degrees(number_slider_7), Center=deplane.Origin, Axis=line)  # -> Geometry, Transform; disabled
data = Data(prot)

# ---- group: PTP平順運動方式
ptp_move = PTPMovementKUKAPrc(TargetAsPlane=data, ExternalAxis1="750", extaxenabled=True, interpolation="C_PTP")  # -> flatten(KUKAPrcCommand)

# ---- group: LIN線性運動方式
lin_move = LINearMovementKUKAPrc(TargetAsPlane=data, ExternalAxis1="750", extaxenabled=True, interpolation="C_DIS")  # -> flatten(KUKAPrcCommand)

# ----
filter_4 = StreamFilter(Gate=list, Stream0=ptp_move, Stream1=lin_move)
data_2 = Data(filter_4)

# ----
# East Robot
panel_3 = Panel("W_HSWorkshop_")
concat = Concatenate(FragmentA=panel_3, FragmentB=panel_2)
kuka_prc = KUKAPrcCORE(
    SimulationSlider=number_slider_2,
    KUKAPrcCommands=data_2,
    Tool=custom_tool_2,
    Robot=cluster_2.robot,
    CollisionGeometry=world_collision,
    SaveToggle=True,
    Filename=concat,
    PRC_BaseExpose=False,
    PRC_SaveNameExpose=True,
    PRCsettings="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")  # -> RobotGeometry, AnalysisOutput

# ==== cluster Cluster
kr90_kr270_r2500 = QuantecKR90KR270R2500Robot(infiniterot=False)
panel = Panel("""37.5
2403.3
-2.0
0.0
90.0
-0.1812""")
panel_2 = Panel("""37.0714
2402.8586
-2.0
0.2993
0.0052
0.0001""")
panel_3 = Panel("""0.0
-2400.0
0.0
0.0
90.0
0.0""")
panel_4 = Panel("""-2.06
-2400.320
0
0.01421
-0.0074
0.00""")
west_platform = Mesh(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)
panel_5 = Panel("""675.0
350.0
1150.0
1000.0
-41.0
240.0""")
east_platform = Mesh(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)
rail = Mesh(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)
e1_min = Panel("0")
e1_max = Panel("4270")
item = ListItem(List=panel_3, Index=0, Wrap=True)  # -> Item, Item1, Item2, Item3, Item4, Item5
item_2 = ListItem(List=panel_4, Index=0, Wrap=True)  # -> Item, Item1, Item2, Item3, Item4, Item5
item_3 = ListItem(List=panel, Index=0, Wrap=True)  # -> Item, Item1, Item2, Item3, Item4, Item5
item_4 = ListItem(List=panel_2, Index=0, Wrap=True)  # -> Item, Item1, Item2, Item3, Item4, Item5
custom_robot = CustomRobot(ReferenceRobot=kr90_kr270_r2500, RobotName="KR300-R2500", Layout=panel_5)
frame = FrameKUKAPrc(
    FrameNumber=0,
    XValue=item.Item,
    YValue=item.Item1,
    ZValue=item.Item2,
    AValue=item.Item3,
    BValue=item.Item4,
    CValue=item.Item5,
    toolaxis="X")  # -> KUKAPrcFrame, XYZABCAsPlane
frame_2 = FrameKUKAPrc(
    FrameNumber=0,
    XValue=item_2.Item,
    YValue=item_2.Item1,
    ZValue=item_2.Item2,
    AValue=item_2.Item3,
    BValue=item_2.Item4,
    CValue=item_2.Item5,
    toolaxis="Z")  # -> KUKAPrcFrame, XYZABCAsPlane
frame_3 = FrameKUKAPrc(
    FrameNumber=0,
    XValue=item_3.Item,
    YValue=item_3.Item1,
    ZValue=item_3.Item2,
    AValue=item_3.Item3,
    BValue=item_3.Item4,
    CValue=item_3.Item5,
    toolaxis="X")  # -> KUKAPrcFrame, XYZABCAsPlane
frame_4 = FrameKUKAPrc(
    FrameNumber=0,
    XValue=item_4.Item,
    YValue=item_4.Item1,
    ZValue=item_4.Item2,
    AValue=item_4.Item3,
    BValue=item_4.Item4,
    CValue=item_4.Item5,
    toolaxis="Z")  # -> KUKAPrcFrame, XYZABCAsPlane
deplane = DeconstructPlane(Plane=frame.XYZABCAsPlane)  # -> Origin, XAxis, YAxis, ZAxis
deplane_2 = DeconstructPlane(Plane=frame_3.XYZABCAsPlane)  # -> Origin, XAxis, YAxis, ZAxis
orient = Orient(Geometry=rail, Source=PlaneXY(0, 0, 0), Target=frame_2.XYZABCAsPlane)  # -> Geometry, Transform
orient_2 = Orient(Geometry=west_platform, Source=PlaneXY(0, 0, 0), Target=frame_2.XYZABCAsPlane)  # -> Geometry, Transform
orient_3 = Orient(Geometry=rail, Source=PlaneXY(0, 0, 0), Target=frame_4.XYZABCAsPlane)  # -> Geometry, Transform
orient_4 = Orient(Geometry=east_platform, Source=PlaneXY(0, 0, 0), Target=frame_4.XYZABCAsPlane)  # -> Geometry, Transform
custom_rail = CustomLinearAxisKUKAPrc(
    KUKAPrcRobotInput=custom_robot,
    RobotRail=orient.Geometry,
    RobotPlatform=orient_2.Geometry,
    PositiveLength=e1_max,
    NegativeLength=e1_min,
    PositiveDirection=deplane.XAxis,
    RobotBase=frame_2.XYZABCAsPlane)
custom_rail_2 = CustomLinearAxisKUKAPrc(
    KUKAPrcRobotInput=custom_robot,
    RobotRail=orient_3.Geometry,
    RobotPlatform=orient_4.Geometry,
    PositiveLength=e1_max,
    NegativeLength=e1_min,
    PositiveDirection=deplane_2.XAxis,
    RobotBase=frame_4.XYZABCAsPlane)
robot = ClusterOutput(custom_rail)
robot_2 = ClusterOutput(custom_rail_2)

# ==== cluster Cluster_2
A = ClusterInput()
B = ClusterInput()
dom = ConstructDomain(DomainStart=A, DomainEnd=expr("x*-1", B))
B_2 = ClusterInput()
N = ClusterInput()
S = ClusterInput()
box = CenterBox(Base=B_2, X=dom, Y=dom, Z=dom)
pop3d = Populate3D(Region=box, Count=N, Seed=S)
nurbs = NurbsCurve(Vertices=pop3d, Degree=3, Periodic=False)  # -> Curve, Length, Domain
C = ClusterOutput(nurbs.Curve)

# ==== cluster Cluster_3
N = ClusterInput()
range = Range(Domain=Domain(0, 1), Steps=N)
P = ClusterInput()
R = ClusterInput()
cir = Circle(Plane=P, Radius=R)
C = ClusterInput()
cull_i = CullIndex(List=range, Indices="0", Wrap=True)
B = ClusterInput()
scale = Scale(Geometry=cir, Center=C, Factor=cull_i)  # -> Geometry, Transform
multiplication = Multiplication(A=cull_i, B=B)
seam = Seam(Curve=reparameterize(scale.Geometry), Seam=multiplication)
N_2 = ClusterInput()
N_3 = ClusterInput()
C_2 = ClusterInput()
divide = DivideCurve(Curve=seam, Count=N_2, Kinks=False)  # -> Points, Tangents, Parameters
series = Series(Start=0, Step=N_3, Count=C_2)
item = ListItem(List=divide.Points, Index=0, Wrap=True)
Z = UnitZ(Factor=series)
move = Move(Geometry=flatten(item), Motion=Z)  # -> Geometry, Transform
intcrv = Interpolate(Vertices=move.Geometry, Degree=3, Periodic=False, KnotStyle=1)  # -> Curve, Length, Domain
bbox = BoundingBox(Content=intcrv.Curve, Plane=PlaneXY(0, 0, 0))  # -> Box, Box_2
area = Area(Geometry=bbox.Box)  # -> Area, Centroid
B_2 = ClusterInput()
orient = Orient(Geometry=intcrv.Curve, Source=area.Centroid, Target=B_2)  # -> Geometry, Transform
G = ClusterOutput(orient.Geometry)

# ==== cluster Cluster_4

number_slider = Slider(400, range=0..1000)
number_slider_2 = Slider(400, range=0..1000)
number_slider_3 = Slider(500, range=0..1000)

number_slider_4 = Slider(160, range=0..1000)
number_slider_5 = Slider(185, range=0..1000)
dom = ConstructDomain(DomainStart=number_slider_5, DomainEnd=expr("x*-1", number_slider_5))
dom_2 = ConstructDomain(DomainStart=number_slider_2, DomainEnd=expr("x*-1", number_slider_2))
dom_3 = ConstructDomain(DomainStart=number_slider_3, DomainEnd=expr("x*-1", number_slider_3))
dom_4 = ConstructDomain(DomainStart=number_slider, DomainEnd=expr("x*-1", number_slider))
dom_5 = ConstructDomain(DomainStart=number_slider_4, DomainEnd=expr("x*-1", number_slider_4))
B = ClusterInput()
B_2 = ClusterInput()
box = CenterBox(Base=B, X=dom, Y=dom_5, Z=dom)
box_2 = CenterBox(Base=B_2, X=dom_4, Y=dom_2, Z=dom_3)
B_3 = ClusterOutput(box)
edges = BrepEdges(Brep=box)  # -> Naked, Interior, NonManifold
edges_2 = BrepEdges(Brep=box_2)  # -> Naked, Interior, NonManifold
pipe = Pipe(Curve=edges.Interior, Radius=Slider(6, range=0..10), Caps=0)
pipe_2 = Pipe(Curve=edges_2.Interior, Radius=Slider(6, range=0..10), Caps=0)
P = ClusterOutput(pipe)
P_2 = ClusterOutput(pipe_2)

# ==== cluster Cluster_5
C = ClusterInput()
bbox = BoundingBox(Content=C, Plane=PlaneXY(0, 0, 0), UnionBox=True)  # -> Box, Box_2
area = Area(Geometry=bbox.Box)  # -> Area, Centroid
G = ClusterInput()
B = ClusterInput()
orient = Orient(Geometry=G, Source=area.Centroid, Target=B)  # -> Geometry, Transform
G_2 = ClusterOutput(orient.Geometry)
